# Grasshopper definition holes_script.gh (Grasshopper 1.0.8)
# plug-ins: RhinoCodePluginGH

mesh = Mesh()
mesh_2 = Mesh(<mesh referenced from the Rhino model>)
int = Integer(10)
int_2 = Integer(3)
py3 = Python3Script(
    input_mesh=mesh_2,
    input_boundary_conditions=mesh,
    RUN_ON_CHANGE=Toggle(False),
    G_INPUT=int,
    R_INPUT=int_2,
    VOLUME_FACTOR=Slider(0.504, range=-1..1))  # -> out, result_mesh; inputs input_mesh: Mesh, input_boundary_conditions: list of Mesh, RUN_ON_CHANGE: Boolean, G_INPUT: Int32, R_INPUT: Int32, VOLUME_FACTOR: Double, INTER_ACTIVE: Boolean
# ---------- py3: Python ----------
import sys
import os
import datetime
import rhinoscriptsyntax as rs
if not BASE_PATH:
    BASE_PATH = r"C:\Evolver"
sys.path.append(os.path.join(BASE_PATH,"surface_evolver_grasshopper"))
sys.path.append(os.path.join(BASE_PATH,"surface_evolver_grasshopper", "py_lib"))
import se_grasshopper_entery
se_grasshopper_entery.reload_all_modules(BASE_PATH)

if RUN_ON_CHANGE and input_mesh:


    if not VOLUME_FACTOR:
        VOLUME_FACTOR = 0.5
    if not INTER_ACTIVE:
        INTER_ACTIVE = False
    if not G_INPUT:
        G_INPUT = 20
    if not R_INPUT:
        R_INPUT = 2
    if not input_boundary_conditions:
        input_boundary_conditions = []    
    arguments = {
        "VOLUME_FACTOR": VOLUME_FACTOR,
        "INTER_ACTIVE": INTER_ACTIVE,
        "G_INPUT": G_INPUT,
        "R_INPUT": R_INPUT,
        "BASE_PATH": BASE_PATH,
        "input_mesh": input_mesh,
        "input_boundary_conditions": input_boundary_conditions,
        "result_mesh": {"verts":[], "faces":[]}
    }
    
    se_grasshopper_entery.run_SE(arguments)
    result_mesh = rs.AddMesh(arguments["result_mesh"]["verts"], arguments["result_mesh"]["faces"])
else:
    print("Not running script until 'RUN_ON_CHANGE' is true and 'input_mesh' is set")
# ---------- end py3 ----------
X = UnitX(Factor=400)
panel = Panel(py3.out)
mesh_3 = Mesh(py3.result_mesh)
move = Move(Geometry=mesh_3, Motion=X)  # -> Geometry, Transform
mesh_4 = Mesh(move.Geometry)
